# Grasshopper definition definition.gh (Grasshopper 1.0.7)

# ---- group: Input Params
curvestartverticaloffset = Slider(10, range=0..10)
column_curve_length = Slider(150, range=125..175)
basiccurvelength = Slider(100, range=75..125)
basiccurveheight = Slider(100, range=0..100)
max_columns = Panel("8")
max_rows = Panel("6")
row_curve_order = Panel("3")
column_curve_order = Panel("3")

# ---- group: Basic Column Curve / Series for Sampling Graph Mapper
expression = Expression(x=max_columns, Expression="x-1")
division = Division(A=1, B=expression)
series = Series(Start=0, Step=division, Count=max_columns)

# ----
columns = Slider(7, range=6..8)

# ---- group: Basic Row Curve / Series for Sampling Graph Mapper
expression_2 = Expression(x=max_rows, Expression="x-1")
division_2 = Division(A=1, B=expression_2)
series_2 = Series(Start=0, Step=division_2, Count=max_rows)

# ----
series_3 = Series(Start=0, Step=1, Count=columns)

# ---- group: Basic Row Curve
graph = GraphMapper(
    series_2,
    x0=0,
    x1=1,
    y0=0,
    y1=1,
    container_name="Bezier",
    cpx=[0, 0.4634692967, 0.6796810031, 1],
    cpy=[0.3220852017, 0.2468482852, 0.3519473076, 0.4764174223])

# ---- group: Basic Column Curve
graph_2 = GraphMapper(
    series,
    x0=0,
    x1=1,
    y0=0,
    y1=1,
    container_name="Bezier",
    cpx=[0, 0.4432801604, 0.6381682158, 1],
    cpy=[0.4465093017, 0.251761198, 0.5521735549, 0.534782052])

# ----
rows = Slider(5, range=4..6)

# ---- group: Basic Row Curve / Determine Row Curve Geometry
multiplication = Multiplication(A=graph, B=basiccurveheight)
item = ListItem(List=multiplication, Index=0, Wrap=True)
expression_3 = Expression(x=multiplication, y=item, z=curvestartverticaloffset, Expression="x-y+z")
multiplication_2 = Multiplication(A=series_2, B=basiccurvelength)
pt = ConstructPoint(XCoordinate=0, YCoordinate=multiplication_2, ZCoordinate=expression_3)
intcrv = Interpolate(Vertices=pt, Degree=row_curve_order, Periodic=False, KnotStyle=1)  # -> Curve, Length, Domain

# ---- group: Basic Column Curve / Determine Column Curve Geometry
multiplication_3 = Multiplication(A=graph_2, B=basiccurveheight)
item_2 = ListItem(List=multiplication_3, Index=0, Wrap=True)
expression_4 = Expression(x=multiplication_3, y=item_2, z=curvestartverticaloffset, Expression="x-y+z")
multiplication_4 = Multiplication(A=series, B=column_curve_length)
pt_2 = ConstructPoint(XCoordinate=multiplication_4, YCoordinate=0, ZCoordinate=expression_4)
intcrv_2 = Interpolate(Vertices=pt_2, Degree=column_curve_order, Periodic=False, KnotStyle=1)  # -> Curve, Length, Domain

# ----
item_3 = ListItem(List=series, Index=series_3, Wrap=True)
series_4 = Series(Start=0, Step=1, Count=rows)
item_4 = ListItem(List=series_2, Index=series_4, Wrap=True)

# ---- group: Curve Grid Geometry
subtraction = Subtraction(A=expression_3, B=curvestartverticaloffset)
subtraction_2 = Subtraction(A=expression_4, B=curvestartverticaloffset)
addition = Addition(A=expression_3, B=simplify(graft(subtraction_2)))
addition_2 = Addition(A=expression_4, B=simplify(graft(subtraction)))
pt_3 = ConstructPoint(XCoordinate=simplify(graft(multiplication_4)), YCoordinate=multiplication_2, ZCoordinate=addition)  # -> simplify(Point)
pt_4 = ConstructPoint(XCoordinate=multiplication_4, YCoordinate=simplify(graft(multiplication_2)), ZCoordinate=addition_2)  # -> simplify(Point)
intcrv_3 = Interpolate(Vertices=pt_4, Degree=column_curve_order, Periodic=False, KnotStyle=1)  # -> Curve, Length, Domain
intcrv_4 = Interpolate(Vertices=pt_3, Degree=row_curve_order, Periodic=False, KnotStyle=1)  # -> Curve, Length, Domain

# ----
netsurf = NetworkSurface(CurvesU=flatten(intcrv_4.Curve), CurvesV=flatten(intcrv_3.Curve), Continuity=2)
mounting_surface_offset = Panel("10")
mounting_surface_thickness = Panel("3")
Z = UnitZ(Factor=1)
offset = OffsetSurface(Surface=netsurf, Distance=mounting_surface_offset, Retrim=True)
offset_2 = OffsetSurface(Surface=offset, Distance=mounting_surface_thickness, Retrim=True)
loft = Loft(
    Curves=[offset, offset_2],
    Options={Adjust=False, Closed=False, LoftEnds=0, LoftSimp=0, LoftType=0, Rebuild=10, Refit=0.01})
bvol = BoundaryVolume(Boundaries=[offset, offset_2, loft])

# ---- group: Typing Surface Normals / Determine column curve normals
pt_5 = ConstructPoint(XCoordinate=multiplication_4, YCoordinate=0, ZCoordinate=0)
yz = YZPlane(Origin=pt_5)
pcx = CurvePlane(Curve=intcrv_2.Curve, Plane=yz)  # -> Points, flatten(ParamsC), ParamsP
eval = EvaluateCurve(Curve=intcrv_2.Curve, Parameter=pcx.ParamsC)  # -> Point, Tangent, Angle
Y = UnitY(Factor=1)

# ---- group: Typing Surface Normals / Determine column curve normals / Clean up x-value
devec = DeconstructVector(Vector=eval.Tangent)  # -> XComponent, YComponent, ZComponent
vec = VectorXYZ(XComponent=1, YComponent=devec.YComponent, ZComponent=devec.ZComponent)  # -> Vector, Length

# ---- group: Typing Surface Normals / Determine column curve normals (continued)
amp = Amplitude(Vector=vec.Vector, Amplitude=1)
pl = ConstructPlane(Origin=eval.Point, XAxis=amp, YAxis=Y)

# ---- group: Typing Surface Normals / Determine row curve normals
pt_6 = ConstructPoint(XCoordinate=0, YCoordinate=multiplication_2, ZCoordinate=0)
xz = XZPlane(Origin=pt_6)
pcx_2 = CurvePlane(Curve=intcrv.Curve, Plane=xz)  # -> Points, flatten(ParamsC), ParamsP
eval_2 = EvaluateCurve(Curve=intcrv.Curve, Parameter=pcx_2.ParamsC)  # -> Point, Tangent, Angle
X = UnitX(Factor=1)

# ---- group: Typing Surface Normals / Determine row curve normals / Clean up y-value
devec_2 = DeconstructVector(Vector=eval_2.Tangent)  # -> XComponent, YComponent, ZComponent
vec_2 = VectorXYZ(XComponent=devec_2.XComponent, YComponent=1, ZComponent=devec_2.ZComponent)  # -> Vector, Length

# ---- group: Typing Surface Normals / Determine row curve normals (continued)
amp_2 = Amplitude(Vector=vec_2.Vector, Amplitude=1)
pl_2 = ConstructPlane(Origin=eval_2.Point, XAxis=X, YAxis=amp_2)

# ---- group: Typing Surface Normals / Get surface normals by pythagorean combination of curve normals
vec_3 = Vector(pl_2)
vec_4 = Vector(pl)
devec_3 = DeconstructVector(Vector=vec_4)  # -> XComponent, YComponent, ZComponent
devec_4 = DeconstructVector(Vector=vec_3)  # -> XComponent, YComponent, ZComponent
expression_5 = Expression(x=simplify(graft(devec_3.XComponent)), y=devec_4.YComponent, Expression="sqrt(1-x^2-y^2)")
vec_5 = VectorXYZ(XComponent=simplify(graft(devec_3.XComponent)), YComponent=devec_4.YComponent, ZComponent=expression_5)  # -> Vector, Length

# ---- group: Generate Keycaps
srf = Surface([<surface referenced from the Rhino model> x34])
join = BrepJoin(Breps=srf)  # -> Breps, Closed
Z_2 = UnitZ(Factor=1)
rotate = RotateDirection(Geometry=join.Breps, Center=Point(0, 0, 0), From=Z_2, To=vec_5.Vector)  # -> Geometry, Transform
move = Move(Geometry=rotate.Geometry, Motion=pt_3)  # -> Geometry, Transform
preview = CustomPreview(
    Geometry=move.Geometry,
    Material={diffuse=RGB(221, 160, 221), emission=RGB(66, 48, 66), shine=0.5, specular=RGB(255, 255, 255), transparency=0})
